# Grasshopper definition 211123_ice_tower_spiral.gh (Grasshopper 1.0.7)

number_slider = Slider(12, range=0..16)
subtraction = Subtraction(A=number_slider, B=Slider(6, range=0..10))
range = Range(Domain=Domain(0, 1), Steps=Slider(500, range=50..500))  # -> reverse(Range)
range_2 = Range(Domain=Domain(0, 1), Steps=subtraction)  # -> reverse(Range)
graph = GraphMapper(
    range,
    x0=0,
    x1=1,
    y0=0,
    y1=1,
    container_name="Bezier",
    cpx=[0, 0.420792073, 0.6237623692, 1],
    cpy=[0, 0.3768116236, 0.6159420013, 1])
graph_2 = GraphMapper(
    range,
    x0=0,
    x1=1,
    y0=0,
    y1=1,
    container_name="Bezier",
    cpx=[0, 0.4435817599, 0.6001677513, 1],
    cpy=[1, 0.5963435173, 0.4453443289, 0])
graph_3 = GraphMapper(range, x0=0, x1=1, y0=0, y1=1, container_name="Bezier", cpx=[0, 0.4931704998, 0.5804068446, 1], cpy=[0, 0, 0, 1])
graph_4 = GraphMapper(
    range_2,
    x0=0,
    x1=1,
    y0=0,
    y1=1,
    container_name="Bezier",
    cpx=[0, 0.1649346799, 0.5230182409, 1],
    cpy=[0, 0.5139089823, 0.6614866257, 1])

xy = XYPlane(Origin=Point(0, 0, 0))
prot = RotatePlane(Plane=xy, Angle=degrees(Slider(0, range=-180..180)))

range_3 = Range(Domain=Domain(0, 1), Steps=subtraction)
multiplication = Multiplication(A=graph_4, B=Slider(100, range=0..100))
addition = Addition(A=subtraction, B="1")
graph_5 = GraphMapper(range_3, x0=0, x1=1, y0=0, y1=1, container_name="Bezier", cpx=[0, 0.4397432506, 1, 1], cpy=[1, 1, 0.6003524065, 0])
addition_2 = Addition(A=multiplication, B=Slider(50, range=0..100))
series = Series(Start=number_slider, Step="-1", Count=addition)

# ---- group: 内径
number_slider_2 = Slider(110, range=0..140)

# ---- group: 外径
number_slider_3 = Slider(290, range=0..1000)

# ----
_1辺 = Slider(300, range=0..300)
division = Division(A=_1辺, B="2")
num = Number(division)
num_2 = Number(division)
neg = Negative(Value=num)
neg_2 = Negative(Value=num_2)
dom = ConstructDomain(DomainStart=num, DomainEnd=neg)
dom_2 = ConstructDomain(DomainStart=num_2, DomainEnd=neg_2)
rectangle = Rectangle(Plane=PlaneXY(0, 0, 0), XSize=dom, YSize=dom_2, Radius=0)  # -> Rectangle, Length
crv = Curve(rectangle.Rectangle)

multiplication_2 = Multiplication(A=Slider(150, range=-150..150), B=graph_5)
panel = Panel(multiplication_2)
polygon = Polygon(Plane=prot, Radius=addition_2, Segments=series, FilletRadius=0)  # -> Polygon, Length
division_2 = Division(A=number_slider_2, B="2")
division_3 = Division(A=number_slider_3, B="2")

# ---- group: 投影多角形
rotate = Rotate(Geometry=polygon.Polygon, Angle=degrees(multiplication_2), Plane=PlaneXY(0, 0, 0))  # -> Geometry, Transform

# ----
dom_3 = ConstructDomain(DomainStart=division_2, DomainEnd=division_3)
_1周360 = Slider(360, range=0..1100)
周 = Slider(17, range=3..20)
タワー高さ = Slider(1050, range=0..1100)
remap = RemapNumbers(Value=graph_3, Source=Domain(0, 1), Target=dom_3)  # -> Mapped, Clipped
pt = PointOriented(BasePlane=PlaneXY(0, 0, 0), UComponent=remap.Mapped, VComponent=0, WComponent=0)
multiplication_3 = Multiplication(A=graph, B=_1周360, C=周)
multiplication_4 = Multiplication(A=graph_2, B=タワー高さ)
タワー高さ分以上 = Slider(1200, range=0..10000)

# ---- group: 各節点を放射状に結ぶ
explode = Explode(Curve=rotate.Geometry, Recursive=True)  # -> Segments, Vertices
flip = FlipMatrix(Data=explode.Vertices)
pline = PolyLine(Vertices=flip, Closed=False)

# ----
rotate_2 = Rotate(Geometry=pt, Angle=degrees(multiplication_3), Plane=PlaneXY(0, 0, 0))  # -> Geometry, Transform
Z = UnitZ(Factor=multiplication_4)
Z_2 = UnitZ(Factor=タワー高さ分以上)
move = Move(Geometry=rotate_2.Geometry, Motion=Z)  # -> Geometry, Transform

# ---- group: 螺旋カーブ
intcrv = Interpolate(Vertices=move.Geometry, Degree=3, Periodic=False, KnotStyle=1)  # -> Curve, Length, Domain

# ---- group: 螺旋カーブとの交点用の壁
extr = Extrude(Base=pline, Direction=Z_2)  # -> flatten(Extrusion)

# ----
rotate_3 = Rotate(Geometry=intcrv.Curve, Angle=degrees(Slider(-12, range=-180..180)), Plane=PlaneXY(0, 0, 0))  # -> Geometry, Transform
Z_3 = UnitZ(Factor=Slider(1000, range=0..1000))
move_2 = Move(Geometry=crv, Motion=Z_3)  # -> Geometry, Transform

# ---- group: 回転位置調整後の螺旋カーブ
crv_2 = Curve(rotate_3.Geometry)

# ----
explode_2 = Explode(Curve=crv, Recursive=True)  # -> Segments, Vertices
explode_3 = Explode(Curve=move_2.Geometry, Recursive=True)  # -> Segments, Vertices
bcx = BrepCurve(Brep=extr, Curve=crv_2)  # -> Curves, flatten(Points)
ln = Line(StartPoint=explode_2.Vertices, EndPoint=explode_3.Vertices)

# ---- group: 点群化した螺旋
alongcrv = SortAlongCurve(Points=bcx.Points, Curve=crv_2)  # -> Points, Indices

# ---- group: ねじり度合の調整
lng = ListLength(List=alongcrv.Points)
addition_3 = Addition(A=lng, B="-1")
range_4 = Range(Domain=Domain(0, 1), Steps=addition_3)
graph_6 = GraphMapper(
    range_4,
    x0=0,
    x1=1,
    y0=0,
    y1=1,
    container_name="Bezier",
    cpx=[0, 0.3751026392, 0.7135703564, 1],
    cpy=[0, 0, 0, 0.1772885323])
multiplication_5 = Multiplication(A=graph_6, B=Slider(-250, range=-250..0))
# まだ短い部材が残っている状態
rotate_4 = Rotate(Geometry=alongcrv.Points, Angle=degrees(multiplication_5), Plane=PlaneXY(0, 0, 0))  # -> Geometry, Transform

# ---- group: 多角形化した螺旋
pline_2 = PolyLine(Vertices=rotate_4.Geometry, Closed=False)

# ----
explode_4 = Explode(Curve=pline_2, Recursive=True)  # -> Segments, Vertices
crv_3 = Curve(flatten(explode_4.Segments))
最小部材長さ = Slider(40, range=0..100)
lng_2 = ListLength(List=crv_3)
len = Length(Curve=crv_3)

# ---- group: 仮の横部材ナンバー
series_2 = Series(Start=0, Step=1, Count=lng_2)

# ----
larger = LargerThan(FirstNumber=len, SecondNumber=最小部材長さ)  # -> LargerThan, OrEqualTo

# ---- group: 短すぎる部材の位置を可視可視化して確認
dispatch = Dispatch(List=crv_3, DispatchPattern=larger.OrEqualTo)  # -> ListA, ListB
number_slider_4 = Slider(100, range=0..100)
number_slider_5 = Slider(100, range=0..100)
crv_4 = Curve(dispatch.ListB)
crv_5 = Curve(dispatch.ListA)
len_2 = Length(Curve=crv_5)
len_3 = Length(Curve=crv_4)
subtraction_2 = Subtraction(A=number_slider_4, B=len_2)
subtraction_3 = Subtraction(A=number_slider_4, B=len_3)
division_4 = Division(A=subtraction_2, B="2")
division_5 = Division(A=subtraction_3, B="2")
ext = ExtendCurve(Curve=crv_5, Type=0, Start=division_4, End=division_4)
ext_2 = ExtendCurve(Curve=crv_4, Type=0, Start=division_5, End=division_5)
end = EndPoints(Curve=ext_2)  # -> Start, End
preview = CustomPreview(Geometry=ext, Material=ColourSwatch(SwatchColor=RGB(0, 66, 173)))
preview_2 = CustomPreview(Geometry=ext_2, Material=ColourSwatch(SwatchColor=RGB(255, 0, 225)))

# ---- group: 長さ判定
cull = CullPattern(List=series_2, CullPattern=invert(larger.OrEqualTo))  # -> graft(List)

# ----
addition_4 = Addition(A=cull, B="1")
addition_5 = Addition(A=cull, B="-1")
merge = Merge(Data1=cull, Data2=addition_5, Data3=addition_4)  # -> flatten(Result)

# ---- group: 後ろ部材
item = ListItem(List=crv_3, Index=addition_4, Wrap=invert(True))

# ---- group: 前部材
item_2 = ListItem(List=crv_3, Index=addition_5, Wrap=True)

# ---- group: 長さ不足の部材
item_3 = ListItem(List=crv_3, Index=cull, Wrap=True)

# ----
pframe = PerpFrame(Curve=reparameterize(item_3), Parameter="0.5")
plx = LinePlane(Line=item_2, Plane=pframe)  # -> Point, ParamL, ParamP
plx_2 = LinePlane(Line=item, Plane=pframe)  # -> Point, ParamL, ParamP

# ---- group: 調整不要部材
cull_i = CullIndex(List=crv_3, Indices=merge, Wrap=True)

# ----
end_2 = EndPoints(Curve=item_2)  # -> Start, End
end_3 = EndPoints(Curve=item)  # -> Start, End
merge_2 = Merge(Data1=plx.Point, Data2=plx_2.Point)
avr = Average(Input=merge_2)
pt_2 = Point(end_2.Start)
pt_3 = Point(end_3.End)
merge_3 = Merge(Data1=pt_2, Data2=avr, Data3=pt_3)

# ---- group: 調整後部材
pline_3 = PolyLine(Vertices=merge_3, Closed=False)

# ----
# 短い部材を除去した状態
merge_4 = Merge(Data1=flatten(pline_3), Data2=flatten(cull_i))

# ---- group: 多角形化した螺旋
join = JoinCurves(Curves=merge_4, Preserve=False)

# ----
explode_5 = Explode(Curve=join, Recursive=True)  # -> Segments, Vertices
end_4 = EndPoints(Curve=explode_5.Segments)  # -> Start, End
pt_4 = PointOriented(BasePlane=end_4.Start, UComponent=0, VComponent=0, WComponent=Slider(0, range=0..30))

# ---- group: 構造計算用の接合部材
ln_2 = Line(StartPoint=end_4.Start, EndPoint=pt_4)

# ----
ln_3 = Line(StartPoint=pt_4, EndPoint=end_4.End)
crv_6 = Curve(flatten(ln_3))

# ---- group: 横部材同士の接合部クリアランス
crv_7 = Curve(ln_3)
neg_3 = Negative(Value=Slider(6, range=0..10))
neg_4 = Negative(Value=Slider(5, range=0..10))
ext_3 = ExtendCurve(Curve=crv_7, Type=0, Start=neg_4, End=neg_3)

# ----
crv_8 = Curve(ext_3)
lng_3 = ListLength(List=crv_8)
subtraction_4 = Subtraction(A=lng_3, B="1")
number_slider_6 = Slider(0.32, range=0..1)  # disabled
range_5 = Range(Domain=Domain(0, 1), Steps=subtraction_4)
graph_7 = GraphMapper(
    range_5,
    x0=0,
    x1=1,
    y0=0,
    y1=1,
    container_name="Bezier",
    cpx=[0, 0.393045187, 0.6435263753, 1],
    cpy=[0.1865057349, 0.204986155, 0.2768413424, 0.2215523124])
merge_5 = Merge(
    Data1=number_slider_6,
    Data2=Slider(0.4, range=0..1),
    Data3=Slider(0.5, range=0..1),
    Data4=Slider(0.6, range=0..1),
    Data5=Slider(0.7, range=0..1),
    Data6=Slider(0.8, range=0..1),
    Data7=Slider(0.9, range=0..1))  # -> flatten(Result)

# ---- group: 縦部材の節点候補
eval = EvaluateCurve(Curve=reparameterize(graft(crv_8)), Parameter=merge_5)  # -> Point, Tangent, Angle

# ---- group: 縦部材の下の節点
eval_2 = EvaluateCurve(Curve=reparameterize(crv_8), Parameter=graph_7)  # -> flatten(Point), Tangent, Angle

# ----
preview_3 = CustomPreview(Geometry=eval_2.Point, Material=ColourSwatch(SwatchColor=RGB(21, 0, 255)))
およその螺旋ピッチ = Slider(40, range=0..100)
pt_5 = Point(graft(eval_2.Point))
pt_6 = Point(flatten(eval.Point))

# ---- group: 縦部材の下の節点
pt_7 = Point(graft(eval_2.Point))

# ----
pdecon = Deconstruct(Point=pt_6)  # -> XComponent, YComponent, ZComponent
pdecon_2 = Deconstruct(Point=pt_5)  # -> XComponent, YComponent, ZComponent
addition_6 = Addition(A=pdecon_2.ZComponent, B=およその螺旋ピッチ)
larger_2 = LargerThan(FirstNumber=pdecon.ZComponent, SecondNumber=addition_6)  # -> LargerThan, OrEqualTo
cull_2 = CullPattern(List=pt_6, CullPattern=larger_2.OrEqualTo)

# ---- group: 近い順に何点かピック
cps = ClosestPoints(Point=pt_7, Cloud=cull_2, Count=Slider(8, range=0..10))  # -> ClosestPoint, CPIndex, Distance

# ---- group: 縦部材の下の節点
pt_8 = Point(pt_7)

# ----
ln_4 = Line(StartPoint=pt_8, EndPoint=cps.ClosestPoint)  # disabled
pt_9 = PointOriented(BasePlane=PlaneXY(0, 0, 0), UComponent=0, VComponent=0, WComponent=0)

# ---- group: 縦部材の下の節点
pt_10 = Point(pt_8)

# ----
pt_11 = Point(cps.ClosestPoint)
vec2pt = Vector2Pt(PointA=pt_9, PointB=pt_10, Unitize=False)  # -> Vector, Length
vec2pt_2 = Vector2Pt(PointA=pt_9, PointB=pt_11, Unitize=False)  # -> Vector, Length
xy_2 = XYPlane(Origin=Point(0, 0, 0))
angle = Angle(VectorA=vec2pt.Vector, VectorB=vec2pt_2.Vector, Plane=xy_2)  # -> Angle, Reflex
pi = Pi(Factor=1)
smaller = SmallerThan(FirstNumber=angle.Angle, SecondNumber=pi)  # -> SmallerThan, OrEqualTo

# ---- group: 傾き方向一致のみ選出
cull_3 = CullPattern(List=pt_11, CullPattern=smaller.SmallerThan)

# ----
pdecon_3 = Deconstruct(Point=cull_3)  # -> XComponent, YComponent, ZComponent
pdecon_4 = Deconstruct(Point=pt_10)  # -> XComponent, YComponent, ZComponent
pdecon_5 = Deconstruct(Point=cull_3)  # -> XComponent, YComponent, ZComponent

# ---- group: 縦部材の角度
dom_4 = ConstructDomain(DomainStart=Slider(61, range=50..80), DomainEnd=Slider(75, range=50..80))

# ---- group: 全体高さ
dom_5 = ConstructDomain(DomainStart=Slider(0, range=0..100), DomainEnd=Slider(1200, range=0..10000))

# ----
pt_12 = ConstructPoint(XCoordinate=pdecon_5.XComponent, YCoordinate=pdecon_5.YComponent, ZCoordinate=pdecon_4.ZComponent)
ln_5 = Line(StartPoint=pt_10, EndPoint=pt_12)
ln_6 = Line(StartPoint=pt_10, EndPoint=cull_3)
remap_2 = RemapNumbers(Value=pdecon_3.ZComponent, Source=dom_5, Target=dom_4)  # -> Mapped, Clipped
angle_2 = Angle(VectorA=ln_6, VectorB=ln_5)  # -> Angle, Reflex
deg = Degrees(Radians=angle_2.Angle)
subtraction_5 = Subtraction(A=deg, B=remap_2.Clipped)
abs = Absolute(Value=subtraction_5)
sort = SortList(Keys=abs, ValuesA=cull_3)  # -> Keys, ValuesA
item_4 = ListItem(List=sort.ValuesA, Index=0, Wrap=True)
number_slider_7 = Slider(23, range=0..100)
number_slider_8 = Slider(32, range=0..100)
number_slider_9 = Slider(8, range=0..10)
number_slider_10 = Slider(2, range=0..10)
number_slider_11 = Slider(12, range=0..100)

# ---- group: 縦部材の下の節点
pt_13 = Point(flatten(pt_10))

# ---- group: 縦部材の上の節点
pt_14 = Point(flatten(item_4))

# ----
merge_6 = Merge(Data1=Slider(124, range=0..1000))
toggle = BooleanToggle(True)
cull_i_2 = CullIndex(List=pt_14, Indices=merge_6, Wrap=True)
cull_i_3 = CullIndex(List=pt_13, Indices=merge_6, Wrap=True)
filter = StreamFilter(Gate=toggle, Stream0=pt_13, Stream1=cull_i_3)
filter_2 = StreamFilter(Gate=toggle, Stream0=pt_14, Stream1=cull_i_2)
crv_9 = Curve(flatten(crv_6))

# ---- group: 縦部材の下の節点
pt_15 = Point(flatten(filter))

# ---- group: 縦部材の上の節点
pt_16 = Point(flatten(filter_2))

# ----
ln_7 = Line(StartPoint=pt_15, EndPoint=pt_16)  # -> flatten(Line)
preview_4 = CustomPreview(Geometry=crv_9, Material=ColourSwatch(SwatchColor=RGB(0, 123, 255)))
preview_5 = CustomPreview(Geometry=ln_7, Material=ColourSwatch(SwatchColor=RGB(255, 0, 251)))
series_3 = Series(Start=Slider(4, range=0..10), Step=1, Count=Slider(11, range=0..12))
number_slider_12 = Slider(0.533, range=0..1)
item_5 = ListItem(List=crv_9, Index=series_3, Wrap=True)
number_slider_13 = Slider(0.533, range=0..1)
merge_7 = Merge(
    Data1=number_slider_12,
    Data2=number_slider_12,
    Data3=number_slider_12,
    Data4=number_slider_12,
    Data5=number_slider_12,
    Data6=number_slider_12,
    Data7=number_slider_12,
    Data8=number_slider_12,
    Data9=number_slider_12,
    Data10=number_slider_12,
    Data11=number_slider_12)
project = Project(Geometry=item_5, Plane=PlaneXY(0, 0, 0))  # -> Geometry, Transform
subtraction_6 = Subtraction(A="1", B=number_slider_13)
panel_2 = Panel(item_5)
merge_8 = Merge(Data2=number_slider_13, Data3=Slider(0.69, range=0..1))
addition_7 = Addition(A=merge_7)
explode_6 = Explode(Curve=project.Geometry, Recursive=True)  # -> Segments, Vertices
explode_7 = Explode(Curve=item_5, Recursive=True)  # -> Segments, Vertices
panel_3 = Panel(merge_7)
division_6 = Division(A=Slider(9.2, range=0..10), B="2")
division_7 = Division(A=Slider(1.9, range=0..10), B="2")
Z_4 = UnitZ(Factor=division_6)
panel_4 = Panel(explode_7.Segments)
Z_5 = UnitZ(Factor=division_7)
move_3 = Move(Geometry=explode_6.Segments, Motion=Z_4)  # -> flatten(Geometry), Transform
eval_3 = EvaluateCurve(Curve=reparameterize(explode_7.Segments), Parameter=merge_8)  # -> Point, Tangent, Angle
hframe = HorizontalFrame(Curve=reparameterize(explode_6.Segments), Parameter=merge_8)
move_4 = Move(Geometry=explode_6.Segments, Motion=Z_5)  # -> flatten(Geometry), Transform
panel_5 = Panel(move_3.Geometry)
panel_6 = Panel(move_4.Geometry)
neg_5 = Negative(Value=Slider(34, range=0..100))
pln = Plane(hframe)
pframe_2 = PerpFrame(Curve=reparameterize(move_3.Geometry), Parameter="0.5")
ln_8 = Line(StartPoint=eval_3.Point, EndPoint=hframe)
lng_4 = ListLength(List=move_3.Geometry)
hframe_2 = HorizontalFrame(Curve=reparameterize(move_3.Geometry), Parameter="0.5")
ln_9 = Line(StartPoint=eval_3.Point, EndPoint=hframe)
pt_17 = PointOriented(BasePlane=pln, UComponent=0, VComponent=neg_5, WComponent=0)
pframe_3 = PerpFrame(Curve=reparameterize(move_4.Geometry), Parameter="0.5")
lng_5 = ListLength(List=move_4.Geometry)
hframe_3 = HorizontalFrame(Curve=reparameterize(move_4.Geometry), Parameter="0.5")
vec2pt_3 = Vector2Pt(PointA=hframe, PointB=pt_17, Unitize=False)  # -> Vector, Length
vec2pt_4 = Vector2Pt(PointA=hframe, PointB=eval_3.Point, Unitize=False)  # -> Vector, Length
prot_2 = RotatePlane(Plane=pframe_2, Angle=degrees("-90"))
pl = ConstructPlane(Origin=eval_3.Point, XAxis=vec2pt_4.Vector, YAxis=vec2pt_3.Vector)
rotate_5 = Rotate(Geometry=pl, Angle=1.570796327, Plane=hframe)  # -> Geometry, Transform
ln_10 = Line(StartPoint=pln, EndPoint=pt_17)
prot_3 = RotatePlane(Plane=pframe_3, Angle=degrees("-90"))
panel_7 = Panel(pl)
rotate_6 = Rotate(Geometry=prot_2, Angle=degrees("90"), Plane=hframe_2)  # -> Geometry, Transform
rotate_7 = Rotate(Geometry=prot_3, Angle=degrees("90"), Plane=hframe_3)  # -> Geometry, Transform
number_slider_14 = Slider(5, range=0..100)
pt_18 = PointOriented(BasePlane=pl, UComponent=number_slider_14, VComponent=0, WComponent=0)

# ---- group: 展開用縦部材
division_8 = Division(A=Slider(114, range=0..114), B="2")
division_9 = Division(A=Slider(9.3, range=0..10), B="2")
neg_6 = Negative(Value=division_8)
neg_7 = Negative(Value=division_9)
dom_6 = ConstructDomain(DomainStart=division_8, DomainEnd=neg_6)
dom_7 = ConstructDomain(DomainStart=division_9, DomainEnd=neg_7)
rectangle_2 = Rectangle(Plane=hframe_3, XSize=dom_6, YSize=dom_7, Radius=0)  # -> Rectangle, Length

number_slider_15 = Slider(114, range=0..114)  # disabled
number_slider_16 = Slider(9.3, range=0..10)  # disabled
panel_8 = Panel("2")  # disabled
panel_9 = Panel("2")  # disabled
division_10 = Division(A=number_slider_15, B=panel_9)  # disabled
division_11 = Division(A=number_slider_16, B=panel_8)  # disabled
neg_8 = Negative(Value=division_10)  # disabled
neg_9 = Negative(Value=division_11)  # disabled
dom_8 = ConstructDomain(DomainStart=division_10, DomainEnd=neg_8)  # disabled
dom_9 = ConstructDomain(DomainStart=division_11, DomainEnd=neg_9)  # disabled
rectangle_3 = Rectangle(Plane=rotate_6.Geometry, XSize=dom_8, YSize=dom_9, Radius=0)  # -> Rectangle, Length; disabled

# ----
pl_origin = PlaneOrigin(Base=pl, Origin=pt_18)
series_4 = Series(Start=0, Step=1, Count=lng_4)
dist = Distance()
num_3 = Number(number_slider_14)

# ---- group: 展開用縦部材
division_12 = Division(A=Slider(5, range=0..114), B="2")
division_13 = Division(A=Slider(1.9, range=0..10), B="2")
neg_10 = Negative(Value=num_3)
neg_11 = Negative(Value=division_13)
dom_10 = ConstructDomain(DomainStart=division_12, DomainEnd=neg_10)
dom_11 = ConstructDomain(DomainStart=division_13, DomainEnd=neg_11)
rectangle_4 = Rectangle(Plane=rotate_5.Geometry, XSize=neg_10, YSize=dom_11, Radius=0)  # -> Rectangle, Length

number_slider_17 = Slider(114, range=0..114)
division_14 = Division(A=number_slider_17, B="2")
division_15 = Division(A=Slider(9.3, range=0..10), B="2")
neg_12 = Negative(Value=number_slider_17)
neg_13 = Negative(Value=division_15)
dom_12 = ConstructDomain(DomainStart=division_14, DomainEnd=neg_12)
dom_13 = ConstructDomain(DomainStart=division_15, DomainEnd=neg_13)
rectangle_5 = Rectangle(Plane=pl_origin, XSize=neg_12, YSize=dom_13, Radius=0)  # -> Rectangle, Length

division_16 = Division(A=Slider(5, range=0..114), B="2")
division_17 = Division(A=Slider(1.9, range=0..10), B="2")
neg_14 = Negative(Value=num_3)
neg_15 = Negative(Value=division_17)
dom_14 = ConstructDomain(DomainStart=division_16, DomainEnd=neg_14)
dom_15 = ConstructDomain(DomainStart=division_17, DomainEnd=neg_15)
rectangle_6 = Rectangle(Plane=pl_origin, XSize=neg_14, YSize=dom_15, Radius=0)  # -> Rectangle, Length

# ----
concat = Concatenate(FragmentA="B", FragmentB=series_4)
tag = TextTag3D(
    Location=rotate_6.Geometry,
    Text=concat,
    Size=Slider(7, range=0..20),
    Colour=ColourSwatch(SwatchColor=RGB(247, 255, 0)),
    Justification=Slider(8, range=0..10))
crv_10 = Curve(crv_9)
number_slider_18 = Slider(5, range=0..10)  # disabled

# ---- group: 横部材軸
crv_11 = Curve(crv_9)  # disabled
部材長さ = Slider(114, range=0..114)  # disabled
len_4 = Length(Curve=crv_11)  # disabled
subtraction_7 = Subtraction(A=部材長さ, B=len_4)  # disabled
panel_10 = Panel("2")  # disabled
division_18 = Division(A=subtraction_7, B=panel_10)
ext_4 = ExtendCurve(Curve=crv_11, Type=0, Start=division_18, End=division_18)

# ---- group: 縦部材の軸
crv_12 = Curve(ln_7)  # disabled
部材長さ_2 = Slider(114, range=0..114)  # disabled
len_5 = Length(Curve=crv_12)  # disabled
subtraction_8 = Subtraction(A=部材長さ_2, B=len_5)  # disabled
panel_11 = Panel("2")  # disabled
division_19 = Division(A=subtraction_8, B=panel_11)
ext_5 = ExtendCurve(Curve=crv_12, Type=0, Start=division_19, End=division_19)

# ---- group: 横部材起点
pframe_4 = PerpFrame(Curve=reparameterize(crv_9), Parameter="0.5")
Z_6 = UnitZ(Factor=1)
align = AlignPlane(Plane=pframe_4, Direction=Z_6)  # -> Plane, Angle
deplane = DeconstructPlane(Plane=align.Plane)  # -> Origin, XAxis, YAxis, ZAxis
rot3d = Rotate3D(Geometry=align.Plane, Angle=degrees(Slider(90, range=0..100)), Center=deplane.Origin, Axis=deplane.XAxis)  # -> Geometry, Transform
neg_16 = Negative(Value=Slider(90, range=0..90))
prot_4 = RotatePlane(Plane=rot3d.Geometry, Angle=degrees(neg_16))

# ---- group: 縦部材の上の節点
pt_19 = Point(graft(pt_16))

# ---- group: 横部材軸
crv_13 = Curve(crv_10)

crv_14 = Curve(crv_10)

# ---- group: 縦部材の下の節点
pt_20 = Point(graft(pt_15))

# ---- group: 横部材軸
crv_15 = Curve(crv_10)

# ----
xy_3 = XYPlane(Origin=Point(0, 0, 0))
crv_cp = CurveClosestPoint(Point=graft(pt_20), Curve=crv_15)  # -> Point, Parameter, Distance
boundary = BoundarySurfaces(Edges=rectangle_5.Rectangle)
crv_cp_2 = CurveClosestPoint(Point=graft(pt_19), Curve=crv_14)  # -> Point, Parameter, Distance
lng_6 = ListLength(List=crv_15)
lng_7 = ListLength(List=crv_14)
pln_2 = Plane(flatten(pl_origin))
dist_2 = Distance(PointA=pt_20, PointB=crv_cp.Point)
series_5 = Series(Start=0, Step=1, Count=lng_6)
dist_3 = Distance(PointA=pt_19, PointB=crv_cp_2.Point)
lng_8 = ListLength(List=crv_13)
series_6 = Series(Start=0, Step=1, Count=lng_7)
deplane_2 = DeconstructPlane(Plane=pln_2)  # -> Origin, XAxis, YAxis, ZAxis
series_7 = Series(Start=0, Step=1, Count=lng_8)
int = Integer(dist_2)
int_2 = Integer(dist_3)
number_slider_19 = Slider(10, range=0..10)
sec = BrepPlane(Brep=boundary, Plane=xy_3)  # -> flatten(Curves), Points
equals = Equality(FirstNumber=int, SecondNumber="0")  # -> Equality, Inequality
crv_16 = Curve(flatten(rectangle_6.Rectangle))
equals_2 = Equality(FirstNumber=int_2, SecondNumber="0")  # -> Equality, Inequality
rev = Reverse(Vector=deplane_2.XAxis)
end_5 = EndPoints(Curve=crv_16)  # -> Start, End
pl_2 = ConstructPlane(Origin=deplane_2.Origin, XAxis=rev, YAxis=deplane_2.YAxis)

# ---- group: 下端の横部材ナンバー
cull_4 = CullPattern(List=series_5, CullPattern=equals.Equality)

# ---- group: 可動軸を減らすため、下部横部材と直交する向きとする
int_3 = Integer(cull_4)
end_6 = EndPoints(Curve=ln_7)  # -> Start, End
item_6 = ListItem(List=crv_9, Index=int_3, Wrap=True)
crv_cp_3 = CurveClosestPoint(Point=graft(end_6.Start), Curve=item_6)  # -> Point, Parameter, Distance
hframe_4 = HorizontalFrame(Curve=item_6, Parameter=crv_cp_3.Parameter)
deplane_3 = DeconstructPlane(Plane=hframe_4)  # -> Origin, XAxis, YAxis, ZAxis

# ----
pframe_5 = PerpFrame(Curve=reparameterize(ln_7), Parameter="0.5")
pdecon_6 = Deconstruct(Point=end_6.Start)  # -> XComponent, YComponent, ZComponent
pt_21 = ConstructPoint(XCoordinate=0, YCoordinate=0, ZCoordinate=pdecon_6.ZComponent)
vec2pt_5 = Vector2Pt(PointA=pt_21, PointB=end_6.Start, Unitize=False)  # -> Vector, Length
align_2 = AlignPlane(Plane=pframe_5, Direction=flatten(deplane_3.YAxis))  # -> Plane, Angle
deplane_4 = DeconstructPlane(Plane=align_2.Plane)  # -> Origin, XAxis, YAxis, ZAxis
pl_3 = ConstructPlane(Origin=deplane_4.Origin, XAxis=deplane_4.XAxis, YAxis=deplane_4.ZAxis)
prot_5 = RotatePlane(Plane=pl_3, Angle=degrees(Slider(90, range=0..100)))
rot3d_2 = Rotate3D(Geometry=prot_5, Angle=degrees(Slider(90, range=0..100)), Center=deplane_4.Origin, Axis=deplane_4.ZAxis)  # -> Geometry, Transform

# ---- group: 放射方向確認
ln_11 = Line(StartPoint=pt_21, EndPoint=pframe_5)

# ---- group: 上端の横部材ナンバー
cull_5 = CullPattern(List=series_6, CullPattern=equals_2.Equality)

# ----
item_7 = ListItem(List=cull_4, Index=0, Wrap=True)  # -> flatten(Item)
item_8 = ListItem(List=cull_5, Index=0, Wrap=True)  # -> flatten(Item)
pt_22 = PointOriented(BasePlane=pln_2, UComponent=number_slider_19, VComponent=number_slider_19, WComponent=0)
swatch = ColourSwatch(SwatchColor=RGB(255, 102, 0))  # disabled

# ---- group: 横部材基準線
crv_17 = Curve(ext_4)

# ---- group: 縦部材基準線
crv_18 = Curve(ext_5)

# ----
lng_9 = ListLength(List=flatten(crv_18))
lng_10 = ListLength(List=flatten(crv_17))
panel_12 = Panel(sec.Curves)
panel_13 = Panel(cull_4)
panel_14 = Panel(lng_9)
panel_15 = Panel(lng_10)

# ---- group: 展開起点
pln_3 = Plane(graft(prot_5))

pln_4 = Plane(graft(prot_4))

# ---- group: タグ起点
pln_5 = Plane(prot_4)

pln_6 = Plane(rot3d_2.Geometry)

# ----
panel_16 = Panel(crv_16)
division_20 = Division(A=Slider(114, range=0..114), B="2")
division_21 = Division(A=Slider(9.2, range=0..10), B="2")
division_22 = Division(A=Slider(114, range=0..114), B="2")
division_23 = Division(A=Slider(9.4, range=0..10), B="2")
neg_17 = Negative(Value=division_20)
neg_18 = Negative(Value=division_21)
neg_19 = Negative(Value=division_22)
neg_20 = Negative(Value=division_23)
dom_16 = ConstructDomain(DomainStart=division_20, DomainEnd=neg_17)
dom_17 = ConstructDomain(DomainStart=division_21, DomainEnd=neg_18)
dom_18 = ConstructDomain(DomainStart=division_22, DomainEnd=neg_19)
dom_19 = ConstructDomain(DomainStart=division_23, DomainEnd=neg_20)
rectangle_7 = Rectangle(Plane=pln_3, XSize=dom_16, YSize=dom_17, Radius=0)  # -> Rectangle, Length
rectangle_8 = Rectangle(Plane=pln_4, XSize=dom_18, YSize=dom_19, Radius=0)  # -> Rectangle, Length
pln_7 = Plane(pln_3)
pln_8 = Plane(pln_4)

# ---- group: 展開用横部材
division_24 = Division(A=Slider(114, range=0..114), B="2")
division_25 = Division(A=Slider(9.3, range=0..10), B="2")
neg_21 = Negative(Value=division_24)
neg_22 = Negative(Value=division_25)
dom_20 = ConstructDomain(DomainStart=division_24, DomainEnd=neg_21)
dom_21 = ConstructDomain(DomainStart=division_25, DomainEnd=neg_22)
rectangle_9 = Rectangle(Plane=pln_4, XSize=dom_20, YSize=dom_21, Radius=0)  # -> Rectangle, Length

number_slider_20 = Slider(8.6, range=0..10)
division_26 = Division(A=Slider(114, range=0..114), B="2")
division_27 = Division(A=number_slider_20, B="2")
neg_23 = Negative(Value=division_26)
neg_24 = Negative(Value=division_27)
dom_22 = ConstructDomain(DomainStart=division_26, DomainEnd=neg_23)
dom_23 = ConstructDomain(DomainStart=division_27, DomainEnd=neg_24)
rectangle_10 = Rectangle(Plane=pln_4, XSize=dom_22, YSize=dom_23, Radius=0)  # -> Rectangle, Length

# ---- group: 展開用縦部材
division_28 = Division(A=Slider(114, range=0..114), B="2")
division_29 = Division(A=Slider(9.3, range=0..10), B="2")
neg_25 = Negative(Value=division_28)
neg_26 = Negative(Value=division_29)
dom_24 = ConstructDomain(DomainStart=division_28, DomainEnd=neg_25)
dom_25 = ConstructDomain(DomainStart=division_29, DomainEnd=neg_26)
rectangle_11 = Rectangle(Plane=pln_3, XSize=dom_24, YSize=dom_25, Radius=0)  # -> Rectangle, Length

division_30 = Division(A=Slider(114, range=0..114), B="2")
division_31 = Division(A=Slider(9.3, range=0..10), B="2")
neg_27 = Negative(Value=division_30)
neg_28 = Negative(Value=division_31)
dom_26 = ConstructDomain(DomainStart=division_30, DomainEnd=neg_27)
dom_27 = ConstructDomain(DomainStart=division_31, DomainEnd=neg_28)
rectangle_12 = Rectangle(Plane=pln_3, XSize=dom_26, YSize=dom_27, Radius=0)  # -> Rectangle, Length

# ---- group: 横部材の起点のナンバリング
pt_23 = PointOriented(BasePlane=pln_5, UComponent=0, VComponent=Slider(6, range=0..10), WComponent=0)
pl_origin_2 = PlaneOrigin(Base=pln_5, Origin=pt_23)
lng_11 = ListLength(List=pl_origin_2)
series_8 = Series(Start=0, Step=1, Count=lng_11)
concat_2 = Concatenate(FragmentA="H", FragmentB=series_8)
tag_2 = TextTag3D(
    Location=pl_origin_2,
    Text=concat_2,
    Size=Slider(7, range=0..20),
    Colour=ColourSwatch(SwatchColor=RGB(247, 255, 0)),
    Justification=Slider(8, range=0..10))

# ---- group: 縦部材の起点のナンバリング
pt_24 = PointOriented(BasePlane=pln_6, UComponent=0, VComponent=Slider(2, range=0..10), WComponent=0)
pl_origin_3 = PlaneOrigin(Base=pln_6, Origin=pt_24)
lng_12 = ListLength(List=pl_origin_3)
series_9 = Series(Start=0, Step=1, Count=lng_12)
concat_3 = Concatenate(FragmentA="V", FragmentB=series_9)
tag_3 = TextTag3D(
    Location=pl_origin_3,
    Text=concat_3,
    Size=Slider(7, range=0..20),
    Colour=ColourSwatch(SwatchColor=RGB(8, 0, 255)),
    Justification=Slider(8, range=0..10))

# ----
pln_9 = Plane(pln_7)
pln_10 = Plane(pln_8)
crv_19 = Curve(rectangle_8.Rectangle)
pln_11 = Plane(pln_7)
crv_20 = Curve(rectangle_7.Rectangle)
部材圧 = Slider(2, range=0..10)
部材圧_2 = Slider(2, range=0..10)
pln_12 = Plane(pln_8)
deplane_5 = DeconstructPlane(Plane=pln_11)  # -> Origin, XAxis, YAxis, ZAxis
fillet = Fillet(Curve=crv_20, Radius=Slider(5, range=0..10))
deplane_6 = DeconstructPlane(Plane=pln_10)  # -> Origin, XAxis, YAxis, ZAxis
fillet_2 = Fillet(Curve=crv_19, Radius=Slider(5, range=0..10))
division_32 = Division(A=部材圧, B="2")
division_33 = Division(A=部材圧_2, B="2")

crv_21 = Curve([<curve referenced from the Rhino model> x150])
area = Area(Geometry=crv_21)  # -> Area, Centroid
pdecon_7 = Deconstruct(Point=area.Centroid)  # -> XComponent, YComponent, ZComponent
cset = CreateSet(List=pdecon_7.XComponent)  # -> Set, Map
cset_2 = CreateSet(List=pdecon_7.YComponent)  # -> Set, Map
sort_2 = SortList(Keys=cset_2.Set)  # -> reverse(Keys), ValuesA
sort_3 = SortList(Keys=cset.Set)  # -> Keys, ValuesA
pt_25 = ConstructPoint(XCoordinate=graft(sort_3.Keys), YCoordinate=sort_2.Keys, ZCoordinate=0)  # -> flatten(Point)
xy_4 = XYPlane(Origin=pt_25)
points = PointList(Points=pt_25, Size=Slider(8, range=0..100))

crv_22 = Curve([<curve referenced from the Rhino model> x150])
area_2 = Area(Geometry=crv_22)  # -> Area, Centroid
pdecon_8 = Deconstruct(Point=area_2.Centroid)  # -> XComponent, YComponent, ZComponent
cset_3 = CreateSet(List=pdecon_8.XComponent)  # -> Set, Map
cset_4 = CreateSet(List=pdecon_8.YComponent)  # -> Set, Map
sort_4 = SortList(Keys=cset_4.Set)  # -> reverse(Keys), ValuesA
sort_5 = SortList(Keys=cset_3.Set)  # -> Keys, ValuesA
pt_26 = ConstructPoint(XCoordinate=graft(sort_5.Keys), YCoordinate=sort_4.Keys, ZCoordinate=0)  # -> flatten(Point)
xy_5 = XYPlane(Origin=pt_26)
points_2 = PointList(Points=pt_26, Size=Slider(8, range=0..100))

crv_23 = Curve(graft(rectangle_10.Rectangle))
pln_13 = Plane(graft(pln_4))
部材厚 = Slider(1.9, range=0..10)
deplane_7 = DeconstructPlane(Plane=pln_13)  # -> Origin, XAxis, YAxis, ZAxis
division_34 = Division(A=部材厚, B="2")
boundary_2 = BoundarySurfaces(Edges=crv_23)
amp = Amplitude(Vector=deplane_7.ZAxis, Amplitude=division_34)
rev_2 = Reverse(Vector=deplane_7.ZAxis)
amp_2 = Amplitude(Vector=rev_2, Amplitude=部材厚)
move_5 = Move(Geometry=boundary_2, Motion=amp)  # -> Geometry, Transform
extr_2 = Extrude(Base=move_5.Geometry, Direction=amp_2)

pln_14 = Plane(graft(pln_4))
crv_24 = Curve(graft(rectangle_9.Rectangle))
部材厚_2 = Slider(2, range=0..10)
deplane_8 = DeconstructPlane(Plane=pln_14)  # -> Origin, XAxis, YAxis, ZAxis
division_35 = Division(A=部材厚_2, B="2")
boundary_3 = BoundarySurfaces(Edges=crv_24)
amp_3 = Amplitude(Vector=deplane_8.ZAxis, Amplitude=division_35)
rev_3 = Reverse(Vector=deplane_8.ZAxis)
amp_4 = Amplitude(Vector=rev_3, Amplitude=部材厚_2)
move_6 = Move(Geometry=boundary_3, Motion=amp_3)  # -> Geometry, Transform
extr_3 = Extrude(Base=move_6.Geometry, Direction=amp_4)

pln_15 = Plane(graft(pln_3))
crv_25 = Curve(graft(rectangle_11.Rectangle))
部材厚_3 = Slider(2, range=0..10)
deplane_9 = DeconstructPlane(Plane=pln_15)  # -> Origin, XAxis, YAxis, ZAxis
division_36 = Division(A=部材厚_3, B="2")
boundary_4 = BoundarySurfaces(Edges=crv_25)
amp_5 = Amplitude(Vector=deplane_9.ZAxis, Amplitude=division_36)
rev_4 = Reverse(Vector=deplane_9.ZAxis)
amp_6 = Amplitude(Vector=rev_4, Amplitude=部材厚_3)
move_7 = Move(Geometry=boundary_4, Motion=amp_5)  # -> Geometry, Transform
extr_4 = Extrude(Base=move_7.Geometry, Direction=amp_6)

pln_16 = Plane(graft(pln_3))
crv_26 = Curve(graft(rectangle_12.Rectangle))
部材厚_4 = Slider(2, range=0..10)
deplane_10 = DeconstructPlane(Plane=pln_16)  # -> Origin, XAxis, YAxis, ZAxis
division_37 = Division(A=部材厚_4, B="2")
boundary_5 = BoundarySurfaces(Edges=crv_26)
amp_7 = Amplitude(Vector=deplane_10.ZAxis, Amplitude=division_37)
rev_5 = Reverse(Vector=deplane_10.ZAxis)
amp_8 = Amplitude(Vector=rev_5, Amplitude=部材厚_4)
move_8 = Move(Geometry=boundary_5, Motion=amp_7)  # -> Geometry, Transform
extr_5 = Extrude(Base=move_8.Geometry, Direction=amp_8)

boundary_6 = BoundarySurfaces(Edges=fillet)
amp_9 = Amplitude(Vector=deplane_5.ZAxis, Amplitude=division_32)
rev_6 = Reverse(Vector=deplane_5.ZAxis)
boundary_7 = BoundarySurfaces(Edges=fillet_2)
amp_10 = Amplitude(Vector=deplane_6.ZAxis, Amplitude=division_33)
rev_7 = Reverse(Vector=deplane_6.ZAxis)

# ---- group: 展開用縦部材
division_38 = Division(A=Slider(114, range=0..114), B="2")
division_39 = Division(A=Slider(9.3, range=0..10), B="2")
neg_29 = Negative(Value=division_38)
neg_30 = Negative(Value=division_39)
dom_28 = ConstructDomain(DomainStart=division_38, DomainEnd=neg_29)
dom_29 = ConstructDomain(DomainStart=division_39, DomainEnd=neg_30)
rectangle_13 = Rectangle(Plane=xy_4, XSize=dom_28, YSize=dom_29, Radius=0)  # -> Rectangle, Length

division_40 = Division(A=Slider(114, range=0..114), B="2")
division_41 = Division(A=Slider(9.3, range=0..10), B="2")
neg_31 = Negative(Value=division_40)
neg_32 = Negative(Value=division_41)
dom_30 = ConstructDomain(DomainStart=division_40, DomainEnd=neg_31)
dom_31 = ConstructDomain(DomainStart=division_41, DomainEnd=neg_32)
rectangle_14 = Rectangle(Plane=xy_4, XSize=dom_30, YSize=dom_31, Radius=0)  # -> Rectangle, Length

# ----
amp_11 = Amplitude(Vector=rev_6, Amplitude=部材圧)
amp_12 = Amplitude(Vector=rev_7, Amplitude=部材圧_2)

# ---- group: 展開用縦部材
division_42 = Division(A=Slider(114, range=0..114), B="2")
division_43 = Division(A=Slider(9.3, range=0..10), B="2")
neg_33 = Negative(Value=division_42)
neg_34 = Negative(Value=division_43)
dom_32 = ConstructDomain(DomainStart=division_42, DomainEnd=neg_33)
dom_33 = ConstructDomain(DomainStart=division_43, DomainEnd=neg_34)
rectangle_15 = Rectangle(Plane=xy_5, XSize=dom_32, YSize=dom_33, Radius=0)  # -> Rectangle, Length

# ----
move_9 = Move(Geometry=boundary_6, Motion=amp_9)  # -> Geometry, Transform
move_10 = Move(Geometry=boundary_7, Motion=amp_10)  # -> Geometry, Transform

int_4 = Integer(graft(series_7))
int_5 = Integer(item_8)
lng_13 = ListLength(List=int_5)
series_10 = Series(Start=0, Step=1, Count=lng_13)
equals_3 = Equality(FirstNumber=int_4, SecondNumber=int_5)  # -> Equality, Inequality
int_6 = Integer(series_10)
cull_6 = CullPattern(List=int_6, CullPattern=equals_3.Equality)

int_7 = Integer(graft(series_7))
int_8 = Integer(item_7)
lng_14 = ListLength(List=int_8)
series_11 = Series(Start=0, Step=1, Count=lng_14)
equals_4 = Equality(FirstNumber=int_7, SecondNumber=int_8)  # -> Equality, Inequality
int_9 = Integer(series_11)
cull_7 = CullPattern(List=int_9, CullPattern=equals_4.Equality)

pln_17 = Plane(flatten(pln_12))
extr_6 = Extrude(Base=move_9.Geometry, Direction=amp_11)  # -> flatten(Extrusion)
extr_7 = Extrude(Base=move_10.Geometry, Direction=amp_12)  # -> flatten(Extrusion)
pln_18 = Plane(flatten(pln_9))
preview_6 = CustomPreview(Geometry=extr_7, Material=ColourSwatch(SwatchColor=RGBA(0, 47, 255, 74)))
preview_7 = CustomPreview(Geometry=extr_6, Material=ColourSwatch(SwatchColor=RGBA(0, 217, 255, 154)))
panel_17 = Panel(pln_18)
panel_18 = Panel(pln_17)

# ---- group: 展開起点
pln_19 = Plane(pln_4)

pln_20 = Plane(pln_3)

# ---- group: 上端の横部材ナンバー
int_10 = Integer(item_8)

# ---- group: 下端の横部材ナンバー
int_11 = Integer(item_7)

# ----
crv_27 = Curve(crv_21)
crv_28 = Curve(crv_22)
swatch_2 = ColourSwatch(SwatchColor=RGB(0, 217, 255))  # disabled
swatch_3 = ColourSwatch(SwatchColor=RGB(0, 47, 255))  # disabled
swatch_4 = ColourSwatch(SwatchColor=RGB(0, 47, 255))  # disabled
swatch_5 = ColourSwatch(SwatchColor=RGB(0, 217, 255))  # disabled
merge_9 = Merge(Data1=cull_6, Data2=cull_7)
preview_8 = CustomPreview(Geometry=extr_2, Material=swatch_4)  # disabled
preview_9 = CustomPreview(Geometry=extr_3, Material=swatch_3)  # disabled
preview_10 = CustomPreview(Geometry=extr_4, Material=swatch_2)  # disabled
preview_11 = CustomPreview(Geometry=extr_5, Material=swatch_5)  # disabled
panel_19 = Panel(xy_5)
number_slider_21 = Slider(27, range=0..100)
addition_8 = Addition(A=Slider(1000, range=0..10000), B=Slider(15, range=0..100))
number_slider_22 = Slider(1.9, range=0..10)
addition_9 = Addition(A=addition_8, B=number_slider_22)
pt_27 = PointOriented(BasePlane=PlaneXY(0, 0, 0), UComponent=0, VComponent=0, WComponent=addition_9)
pt_28 = PointOriented(BasePlane=PlaneXY(0, 0, 0), UComponent=0, VComponent=0, WComponent=addition_8)

# ---- group: 展開起点
pln_21 = Plane(pln_19)

# ----
cyl = Cylinder(Base=pt_28, Radius=Slider(50, range=0..100), Length=number_slider_22)
cyl_2 = Cylinder(Base=pt_27, Radius=Slider(40, range=0..100), Length=Slider(20, range=0..100))

# ---- group: 展開起点
pln_22 = Plane(pln_20)

# ----
cap = CapHoles(Brep=cyl)
cap_2 = CapHoles(Brep=cyl_2)

# ---- group: 縦部材のGLかぶり本数
number_slider_23 = Slider(4, range=0..10)

# ---- group: 展開起点
pln_23 = Plane(pln_19)

pln_24 = Plane(pln_19)

# ---- group: 縦部材のGLかぶり本数
number_slider_24 = Slider(3, range=0..10)

# ---- group: 横部材のGLかぶり本数
number_slider_25 = Slider(1, range=0..10)

# ----
panel_20 = Panel("""横部材
横ジョイント""")
panel_21 = Panel("""横部材
縦ジョイント""")

number_slider_26 = Slider(15, range=0..100)
lng_15 = ListLength(List=flatten(pln_22))
series_12 = Series(Start=0, Step=1, Count=lng_15)

lng_16 = ListLength(List=flatten(pln_21))

lng_17 = ListLength(List=flatten(pln_21))
number_slider_27 = Slider(100, range=0..100)
series_13 = Series(Start=0, Step=1, Count=lng_17)

Z_7 = UnitZ(Factor=1)

# ---- group: 横、展開起点
pln_25 = Plane(flatten(pln_21))

# ----
pln_26 = Plane(xy_4)

number_slider_28 = Slider(100, range=0..100)
lng_18 = ListLength(List=flatten(pln_23))
series_14 = Series(Start=0, Step=1, Count=lng_18)

number_slider_29 = Slider(100, range=0..100)
lng_19 = ListLength(List=flatten(pln_24))
series_15 = Series(Start=0, Step=1, Count=lng_19)

preview_12 = CustomPreview(Geometry=cap_2, Material=ColourSwatch(SwatchColor=RGB(208, 0, 255)))
toggle_2 = BooleanToggle(False)
addition_10 = Addition(A=lng_16, B="-1")
extr_8 = Extrude(Base=rectangle_14.Rectangle, Direction=Z_7)
series_16 = Series(Start=0, Step=1, Count=number_slider_24)
series_17 = Series(Start=number_slider_23, Step=1, Count=Slider(11, range=0..11))
series_18 = Series(Start=0, Step=1, Count=number_slider_25)
panel_23 = Panel("縦部材")
cull_8 = CullPattern(List=toggle_2, CullPattern=toggle_2)
series_19 = Series(Start=0, Step=1, Count=addition_10)
cap_3 = CapHoles(Brep=extr_8)
xy_6 = XYPlane(Origin=Point(0, 0, 0))
item_9 = ListItem(List=pln_18, Index=series_16, Wrap=True)
item_10 = ListItem(List=extr_6, Index=series_16, Wrap=True)
item_11 = ListItem(List=xy_5, Index=series_16, Wrap=True)
item_12 = ListItem(List=cull_8, Index=0, Wrap=True)
xy_7 = XYPlane(Origin=Point(0, 0, 0))
item_13 = ListItem(List=pln_17, Index=series_18, Wrap=True)
item_14 = ListItem(List=pln_17, Index=series_17, Wrap=True)
item_15 = ListItem(List=extr_7, Index=series_18, Wrap=True)
item_16 = ListItem(List=xy_4, Index=series_17, Wrap=True)
item_17 = ListItem(List=xy_4, Index=series_18, Wrap=True)
group = Group(Objects=rectangle_4.Rectangle)  # -> flatten(Group)
int_12 = Integer(graft(series_14))

# ---- group: 横、展開起点
pln_27 = Plane(flatten(pln_23))

pln_28 = Plane(flatten(pln_24))

# ----
int_13 = Integer(graft(series_15))
int_14 = Integer(cull_6)
int_15 = Integer(cull_7)
pln_29 = Plane(xy_4)
crv_29 = Curve(rectangle_13.Rectangle)
int_16 = Integer(cull_6)
int_17 = Integer(cull_7)
pln_30 = Plane(xy_4)
crv_30 = Curve(rectangle_13.Rectangle)
brep = Brep(flatten(extr_2))
brep_2 = Brep(flatten(extr_3))

# ---- group: 縦、展開起点
pln_31 = Plane(flatten(pln_22))

# ----
merge_10 = Merge(Data1=item_12, Data2=series_19)  # -> flatten(Result)
int_18 = Integer(graft(series_12))

# ---- group: 上端の横部材ナンバー
int_19 = Integer(int_10)

# ---- group: 下端の横部材ナンバー
int_20 = Integer(int_11)

# ----
panel_24 = Panel(int_20)
pln_32 = Plane(xy_5)
series_20 = Series(Start="1", Step=1, Count=addition_10)  # -> flatten(Series)
sec_2 = BrepPlane(Brep=item_10, Plane=xy_6)  # -> flatten(Curves), Points
sec_3 = BrepPlane(Brep=item_15, Plane=xy_7)  # -> flatten(Curves), Points
int_21 = Integer(graft(merge_10))
int_22 = Integer(graft(series_20))
brep_3 = Brep(flatten(extr_4))
item_18 = ListItem(List=pln_27, Index=int_12, Wrap=True)
item_19 = ListItem(List=int_14, Index=int_12, Wrap=True)
item_20 = ListItem(List=int_15, Index=int_12, Wrap=True)
item_21 = ListItem(List=pln_29, Index=int_12, Wrap=True)
item_22 = ListItem(List=crv_29, Index=int_12, Wrap=True)
brep_4 = Brep(flatten(extr_4))
item_23 = ListItem(List=pln_28, Index=int_13, Wrap=True)
item_24 = ListItem(List=int_16, Index=int_13, Wrap=True)
item_25 = ListItem(List=int_17, Index=int_13, Wrap=True)
item_26 = ListItem(List=pln_30, Index=int_13, Wrap=True)
item_27 = ListItem(List=crv_30, Index=int_13, Wrap=True)
int_23 = Integer(int_12)
int_24 = Integer(int_13)
item_28 = ListItem(List=pln_31, Index=int_18, Wrap=True)
item_29 = ListItem(List=int_19, Index=int_18, Wrap=True)
item_30 = ListItem(List=pln_32, Index=int_18, Wrap=True)
item_31 = ListItem(List=int_20, Index=int_18, Wrap=True)
int_25 = Integer(int_18)
panel_25 = Panel(item_16)
item_32 = ListItem(List=flatten(extr_3), Index=int_21, Wrap=True)
item_33 = ListItem(List=flatten(extr_3), Index=int_22, Wrap=True)

# ---- group: 組み込み幅の半分
number_slider_30 = Slider(0, range=0..2.7)

# ----
merge_11 = Merge(Data2=item_19)
merge_12 = Merge(Data2=item_25)
orient = Orient(Geometry=sec_3.Curves, Source=item_13, Target=item_17)  # -> Geometry, Transform
orient_2 = Orient(Geometry=sec_2.Curves, Source=item_9, Target=item_11)  # -> Geometry, Transform
orient_3 = Orient(Geometry=group, Source=item_14, Target=item_16)  # -> Geometry, Transform
merge_13 = Merge(Data1=item_29)
merge_14 = Merge(Data1=item_29, Data2=item_31)
panel_26 = Panel(merge_11)
item_34 = ListItem(List=brep_3, Index=merge_11, Wrap=True)
item_35 = ListItem(List=brep_4, Index=merge_12, Wrap=True)
Z_8 = UnitZ(Factor=number_slider_30)
Z_9 = UnitZ(Factor=number_slider_30)
item_36 = ListItem(List=brep, Index=merge_13, Wrap=True)
item_37 = ListItem(List=brep_2, Index=item_31, Wrap=True)
rev_8 = Reverse(Vector=Z_8)
pln_33 = Plane(item_26)
int_26 = Integer(merge_12)
pln_34 = Plane(item_26)
int_27 = Integer(int_24)
move_11 = Move(Geometry=item_32, Motion=rev_8)  # -> Geometry, Transform
move_12 = Move(Geometry=item_33, Motion=Z_9)  # -> Geometry, Transform
orient_4 = Orient(Geometry=item_34, Source=item_18, Target=item_21)  # -> Geometry, Transform
pt_29 = ConstructPoint(XCoordinate=0, YCoordinate=0, ZCoordinate="1")
orient_5 = Orient(Geometry=item_35, Source=item_23, Target=item_26)  # -> Geometry, Transform
pt_30 = ConstructPoint(XCoordinate=0, YCoordinate=0, ZCoordinate="1")
pln_35 = Plane(item_21)
int_28 = Integer(merge_11)
int_29 = Integer(int_23)
orient_6 = Orient(Geometry=item_36, Source=item_28, Target=item_30)  # -> Geometry, Transform
pt_31 = ConstructPoint(XCoordinate=0, YCoordinate=0, ZCoordinate="-1")
pt_32 = ConstructPoint(XCoordinate=0, YCoordinate=0, ZCoordinate="1")
orient_7 = Orient(Geometry=item_37, Source=item_28, Target=item_30)  # -> Geometry, Transform
pt_33 = ConstructPoint(XCoordinate=0, YCoordinate=0, ZCoordinate="-1")
pt_34 = ConstructPoint(XCoordinate=0, YCoordinate=0, ZCoordinate="1")
xy_8 = XYPlane(Origin=pt_29)
xy_9 = XYPlane(Origin=pt_30)
item_38 = ListItem(List=int_26, Index=0, Wrap=True)  # -> Item, Item1
pln_36 = Plane(item_30)
number_slider_31 = Slider(18, range=0..100)
int_30 = Integer(merge_14)
int_31 = Integer(int_25)
int_32 = Integer(graft(series_13))
xy_10 = XYPlane(Origin=pt_31)
xy_11 = XYPlane(Origin=pt_32)
xy_12 = XYPlane(Origin=pt_33)
xy_13 = XYPlane(Origin=pt_34)
item_39 = ListItem(List=int_28, Index=0, Wrap=True)  # -> Item, Item1
merge_15 = Merge(Data1=move_11.Geometry, Data2=move_12.Geometry)
neg_35 = Negative(Value=Slider(47, range=0..100))
sec_4 = BrepPlane(Brep=orient_4.Geometry, Plane=xy_8)  # -> Curves, Points
item_40 = ListItem(List=int_30, Index=0, Wrap=True)  # -> Item, Item1
item_41 = ListItem(List=merge_15, Index=0, Wrap=True)  # -> Item, Item1
sec_5 = BrepPlane(Brep=orient_5.Geometry, Plane=xy_9)  # -> Curves, Points
panel_27 = Panel(item_39.Item)
neg_36 = Negative(Value=Slider(8, range=0..100))
concat_4 = Concatenate(FragmentA="H", FragmentB=int_27)
concat_5 = Concatenate(FragmentA="V", FragmentB=item_38.Item1, FragmentC="→")
neg_37 = Negative(Value=Slider(2, range=0..100))
item_42 = ListItem(List=pln_25, Index=int_32, Wrap=True)
item_43 = ListItem(List=pln_26, Index=int_32, Wrap=True)
item_44 = ListItem(List=cap_3, Index=int_32, Wrap=True)
panel_28 = Panel("→")
pshift = ShiftPaths(Data=sec_4.Curves, Offset=-1)
sec_6 = BrepPlane(Brep=orient_6.Geometry, Plane=xy_11)  # -> Curves, Points
brep_5 = Brep(item_41.Item)
sec_7 = BrepPlane(Brep=orient_6.Geometry, Plane=xy_10)  # -> Curves, Points
brep_6 = Brep(item_41.Item1)
sec_8 = BrepPlane(Brep=orient_7.Geometry, Plane=xy_13)  # -> Curves, Points
pshift_2 = ShiftPaths(Data=sec_5.Curves, Offset=-1)
sec_9 = BrepPlane(Brep=orient_7.Geometry, Plane=xy_12)  # -> Curves, Points
merge_16 = Merge(Data2=neg_36)
concat_6 = Concatenate(FragmentC="←", FragmentA="V", FragmentB=item_39.Item)
concat_7 = Concatenate(FragmentA="H", FragmentB=int_29)
merge_17 = Merge(Data1=neg_35)
xy_14 = XYPlane(Origin=Point(0, 0, 0))
crv_31 = Curve(item_22)
merge_18 = Merge(Data1=pshift)
xy_15 = XYPlane(Origin=Point(0, 0, 0))
crv_32 = Curve(item_27)
merge_19 = Merge(Data1=pshift_2)
concat_8 = Concatenate(FragmentA="H", FragmentB=item_40.Item, FragmentD="→")
concat_9 = Concatenate(FragmentD="←", FragmentA="H", FragmentB=item_40.Item1)
concat_10 = Concatenate(FragmentA="V", FragmentB=int_31)
neg_38 = Negative(Value=number_slider_31)
merge_20 = Merge(Data2=Slider(8, range=0..100))
merge_21 = Merge(Data3=concat_5)
pt_35 = PointOriented(BasePlane=pln_34, UComponent=merge_17, VComponent=0, WComponent=0)
merge_22 = Merge(Data1=concat_4)
merge_23 = Merge(Data1=sec_6.Curves, Data2=sec_7.Curves)
merge_24 = Merge(Data1=sec_8.Curves, Data2=sec_9.Curves)
project_2 = Project(Geometry=merge_18, Plane=xy_14)  # -> Geometry, Transform
project_3 = Project(Geometry=merge_19, Plane=xy_15)  # -> Geometry, Transform
panel_29 = Panel(merge_15)
merge_25 = Merge(Data1=Slider(0, range=0..100), Data2=number_slider_31, Data3=neg_38)
merge_26 = Merge(Data1=concat_6)
orient_8 = Orient(Geometry=brep_5, Source=item_42, Target=item_43)  # -> Geometry, Transform
orient_9 = Orient(Geometry=brep_6, Source=item_42, Target=item_43)  # -> Geometry, Transform
panel_30 = Panel(merge_23)
loft = Loft(Curves=merge_23, Options={Adjust=False, Closed=False, LoftEnds=0, LoftSimp=0, LoftType=0, Rebuild=10, Refit=0.01})  # disabled
explode_8 = Explode(Curve=merge_23, Recursive=True)  # -> Segments, Vertices
loft_2 = Loft(Curves=merge_24, Options={Adjust=False, Closed=False, LoftEnds=0, LoftSimp=0, LoftType=0, Rebuild=10, Refit=0.01})  # disabled
explode_9 = Explode(Curve=merge_24, Recursive=True)  # -> Segments, Vertices
pt_36 = PointOriented(BasePlane=pln_36, UComponent=merge_25, VComponent=0, WComponent=0)
merge_27 = Merge(Data1=concat_10, Data2=concat_8, Data3=concat_9)
len_6 = Length(Curve=explode_8.Segments)
rint = RegionIntersection(CurvesA=project_2.Geometry, CurvesB=crv_31, Plane=xy_14)
area_3 = Area(Geometry=rint)  # -> Area, Centroid
pt_37 = PointOriented(BasePlane=area_3.Centroid, UComponent=merge_20, VComponent=neg_37, WComponent=0)
rint_2 = RegionIntersection(CurvesA=project_3.Geometry, CurvesB=crv_32, Plane=xy_15)
area_4 = Area(Geometry=rint_2)  # -> Area, Centroid
pt_38 = PointOriented(BasePlane=area_4.Centroid, UComponent=merge_16, VComponent=Slider(2, range=0..100), WComponent=0)
number_slider_32 = Slider(4, range=0..10)
cap_4 = CapHoles(Brep=loft)  # disabled
cap_5 = CapHoles(Brep=loft_2)  # disabled
sint = SolidIntersection(BrepsA=orient_8.Geometry, BrepsB=item_44)
sint_2 = SolidIntersection(BrepsA=orient_9.Geometry, BrepsB=item_44)
pshift_3 = ShiftPaths(Data=explode_8.Vertices, Offset=-1)
pshift_4 = ShiftPaths(Data=explode_9.Vertices, Offset=-1)
number_slider_33 = Slider(3, range=0..10)
explode_10 = Explode(Curve=rint, Recursive=True)  # -> Segments, Vertices
boundary_8 = BoundarySurfaces(Edges=rint)
item_45 = ListItem(List=len_6, Index=0, Wrap=True)
explode_11 = Explode(Curve=rint_2, Recursive=True)  # -> Segments, Vertices
item_46 = ListItem(List=merge_24, Index="-1", Wrap=True)
num_4 = Number(number_slider_20)
explode_12 = Explode(Curve=merge_18, Recursive=True)  # -> Segments, Vertices; disabled
merge_28 = Merge(Data2=Slider(3, range=0..10))
merge_29 = Merge(Data1=Slider(4, range=0..10))
explode_13 = Explode(Curve=merge_19, Recursive=True)  # -> Segments, Vertices; disabled
boundary_9 = BoundarySurfaces(Edges=rint_2)
merge_30 = Merge(Data1=Slider(3, range=0..10))
item_47 = ListItem(List=explode_10.Segments, Index="-1", Wrap=True)
item_48 = ListItem(List=explode_10.Segments, Index="1", Wrap=True)
pdecon_9 = Deconstruct(Point=pshift_3)  # -> XComponent, YComponent, ZComponent
pdecon_10 = Deconstruct(Point=pshift_4)  # -> XComponent, YComponent, ZComponent
item_49 = ListItem(List=explode_11.Segments, Index="-1", Wrap=True)
item_50 = ListItem(List=explode_11.Segments, Index="1", Wrap=True)
panel_31 = Panel(merge_24)
panel_32 = Panel(merge_27)
pshift_5 = ShiftPaths(Data=explode_12.Vertices, Offset=-1)
pshift_6 = ShiftPaths(Data=explode_13.Vertices, Offset=-1)
merge_31 = Merge(Data1=Slider(4, range=0..10), Data2=number_slider_33, Data3=number_slider_33)
project_4 = Project(Geometry=sint, Plane=PlaneXY(0, 0, 0))  # -> Geometry, Transform
debrep = DeconstructBrep(Brep=sint)  # -> Faces, Edges, Vertices
project_5 = Project(Geometry=sint_2, Plane=PlaneXY(0, 0, 0))  # -> Geometry, Transform
debrep_2 = DeconstructBrep(Brep=sint_2)  # -> Faces, Edges, Vertices
pt_39 = ConstructPoint(XCoordinate=pdecon_9.XComponent, YCoordinate=pdecon_9.YComponent, ZCoordinate=0)
panel_33 = Panel(item_45)
pt_40 = ConstructPoint(XCoordinate=pdecon_10.XComponent, YCoordinate=pdecon_10.YComponent, ZCoordinate=0)
end_7 = EndPoints(Curve=item_47)  # -> Start, End
end_8 = EndPoints(Curve=item_48)  # -> Start, End
end_9 = EndPoints(Curve=item_49)  # -> Start, End
end_10 = EndPoints(Curve=item_50)  # -> Start, End
explode_14 = Explode(Curve=rint, Recursive=True)  # -> Segments, Vertices
pdecon_11 = Deconstruct(Point=pshift_5)  # -> XComponent, YComponent, ZComponent
pdecon_12 = Deconstruct(Point=pshift_6)  # -> XComponent, YComponent, ZComponent
explode_15 = Explode(Curve=project_4.Geometry, Recursive=True)  # -> Segments, Vertices
explode_16 = Explode(Curve=project_5.Geometry, Recursive=True)  # -> Segments, Vertices
hull = ConvexHull(Points=pt_40, Plane=PlaneXY(0, 0, 0))  # -> Hull, HullZ, Indices
pt_41 = ConstructPoint(XCoordinate=pdecon_11.XComponent, YCoordinate=pdecon_11.YComponent, ZCoordinate=0)
area_5 = Area(Geometry=hull.Hull)  # -> Area, Centroid
pt_42 = ConstructPoint(XCoordinate=pdecon_12.XComponent, YCoordinate=pdecon_12.YComponent, ZCoordinate=0)
pdecon_13 = Deconstruct(Point=debrep.Vertices)  # -> XComponent, YComponent, ZComponent
pdecon_14 = Deconstruct(Point=debrep_2.Vertices)  # -> XComponent, YComponent, ZComponent
crv_cp_4 = CurveClosestPoint(Point=end_8.End, Curve=item_47)  # -> Point, Parameter, Distance
crv_cp_5 = CurveClosestPoint(Point=end_7.End, Curve=item_48)  # -> Point, Parameter, Distance
crv_cp_6 = CurveClosestPoint(Point=end_10.End, Curve=item_49)  # -> Point, Parameter, Distance
crv_cp_7 = CurveClosestPoint(Point=end_9.End, Curve=item_50)  # -> Point, Parameter, Distance
item_51 = ListItem(List=explode_14.Segments, Index=0, Wrap=True)
item_52 = ListItem(List=explode_14.Segments, Index=0, Wrap=True)  # -> Item2, Item1, Item
crv_cp_8 = CurveClosestPoint(Point=area_5.Centroid, Curve=item_46)  # -> Point, Parameter, Distance
hull_2 = ConvexHull(Points=pt_41, Plane=PlaneXY(0, 0, 0))  # -> Hull, HullZ, Indices
hull_3 = ConvexHull(Points=pt_42, Plane=PlaneXY(0, 0, 0))  # -> Hull, HullZ, Indices
pt_43 = ConstructPoint(XCoordinate=pdecon_13.XComponent, YCoordinate=pdecon_13.YComponent, ZCoordinate=0)
pt_44 = ConstructPoint(XCoordinate=pdecon_14.XComponent, YCoordinate=pdecon_14.YComponent, ZCoordinate=0)
xy_16 = XYPlane(Origin=area_5.Centroid)
vec2pt_6 = Vector2Pt(PointA=area_5.Centroid, PointB=crv_cp_8.Point, Unitize=False)  # -> Vector, Length
number_slider_34 = Slider(9, range=0..9.3)
hull_4 = ConvexHull(Points=pt_43, Plane=PlaneXY(0, 0, 0))  # -> Hull, HullZ, Indices
hull_5 = ConvexHull(Points=pt_44, Plane=PlaneXY(0, 0, 0))  # -> Hull, HullZ, Indices
cir = Circle(Plane=end_7.End, Radius=Slider(1, range=0..10))
cir_2 = Circle(Plane=end_9.End, Radius=Slider(1, range=0..10))
neg_39 = Negative(Value=Slider(0.2, range=0..1))
align_3 = AlignPlane(Plane=xy_16, Direction=vec2pt_6.Vector)  # -> Plane, Angle
vec2pt_7 = Vector2Pt(PointA=crv_cp_4.Point, PointB=end_7.Start, Unitize=False)  # -> Vector, Length
vec2pt_8 = Vector2Pt(PointA=crv_cp_4.Point, PointB=end_8.End, Unitize=False)  # -> Vector, Length
vec2pt_9 = Vector2Pt(PointA=crv_cp_5.Point, PointB=end_8.Start, Unitize=False)  # -> Vector, Length
vec2pt_10 = Vector2Pt(PointA=crv_cp_5.Point, PointB=end_7.End, Unitize=False)  # -> Vector, Length
ln_12 = Line(StartPoint=crv_cp_4.Point, EndPoint=end_7.End)
ln_13 = Line(StartPoint=crv_cp_5.Point, EndPoint=end_8.End)
vec2pt_11 = Vector2Pt(PointA=crv_cp_6.Point, PointB=end_9.Start, Unitize=False)  # -> Vector, Length
vec2pt_12 = Vector2Pt(PointA=crv_cp_6.Point, PointB=end_10.End, Unitize=False)  # -> Vector, Length
vec2pt_13 = Vector2Pt(PointA=crv_cp_7.Point, PointB=end_10.Start, Unitize=False)  # -> Vector, Length
vec2pt_14 = Vector2Pt(PointA=crv_cp_7.Point, PointB=end_9.End, Unitize=False)  # -> Vector, Length
ln_14 = Line(StartPoint=crv_cp_6.Point, EndPoint=end_9.End)
ln_15 = Line(StartPoint=crv_cp_7.Point, EndPoint=end_10.End)
Y = UnitY(Factor=Slider(0.2, range=0..1))
Y_2 = UnitY(Factor=neg_39)
pl_4 = ConstructPlane(Origin=crv_cp_4.Point, XAxis=vec2pt_7.Vector, YAxis=vec2pt_8.Vector)
pl_5 = ConstructPlane(Origin=crv_cp_5.Point, XAxis=vec2pt_9.Vector, YAxis=vec2pt_10.Vector)
pl_6 = ConstructPlane(Origin=crv_cp_6.Point, XAxis=vec2pt_11.Vector, YAxis=vec2pt_12.Vector)
pl_7 = ConstructPlane(Origin=crv_cp_7.Point, XAxis=vec2pt_13.Vector, YAxis=vec2pt_14.Vector)
len_7 = Length(Curve=ln_12)
len_8 = Length(Curve=ln_13)
len_9 = Length(Curve=ln_14)
len_10 = Length(Curve=ln_15)
move_13 = Move(Geometry=item_51, Motion=Y)  # -> Geometry, Transform
move_14 = Move(Geometry=item_52.Item2, Motion=Y_2)  # -> Geometry, Transform
division_44 = Division(A=Slider(1.9, range=0..2), B="2")
division_45 = Division(A=Slider(9.1, range=0..10), B="2")
panel_34 = Panel(explode_14.Segments)
end_11 = EndPoints(Curve=item_51)  # -> Start, End
subtraction_9 = Subtraction(A=number_slider_34, B=len_7)
subtraction_10 = Subtraction(A=number_slider_34, B=len_8)
end_12 = EndPoints(Curve=item_52.Item2)  # -> Start, End
end_13 = EndPoints(Curve=move_13.Geometry)  # -> Start, End
end_14 = EndPoints(Curve=move_14.Geometry)  # -> Start, End
subtraction_11 = Subtraction(A=Slider(9.3, range=0..9.3), B=len_9)
subtraction_12 = Subtraction(A=Slider(9.3, range=0..9.3), B=len_10)
neg_40 = Negative(Value=division_44)
neg_41 = Negative(Value=division_45)
division_46 = Division(A=subtraction_9, B="2")
division_47 = Division(A=subtraction_10, B="2")
division_48 = Division(A=subtraction_11, B="2")
division_49 = Division(A=subtraction_12, B="2")
merge_32 = Merge(Data1=end_11.Start, Data2=end_13.Start, Data3=end_13.End, Data4=end_11.End)
merge_33 = Merge(Data1=end_12.Start, Data2=end_14.Start, Data3=end_14.End, Data4=end_12.End)
panel_35 = Panel(explode_11.Segments)
dom_34 = ConstructDomain(DomainStart=division_44, DomainEnd=neg_40)
dom_35 = ConstructDomain(DomainStart=division_45, DomainEnd=neg_41)
ext_6 = ExtendCurve(Curve=ln_12, Type=0, Start=division_46, End=division_46)
ext_7 = ExtendCurve(Curve=ln_13, Type=0, Start=division_47, End=division_47)
ext_8 = ExtendCurve(Curve=ln_14, Type=0, Start=division_48, End=division_48)
ext_9 = ExtendCurve(Curve=ln_15, Type=0, Start=division_49, End=division_49)
crv_33 = Curve(hull_4.Hull)
crv_34 = Curve(hull_5.Hull)
area_6 = Area(Geometry=crv_33)  # -> Area, Centroid
area_7 = Area(Geometry=crv_34)  # -> Area, Centroid
pline_4 = PolyLine(Vertices=merge_32, Closed=False)
pline_5 = PolyLine(Vertices=merge_33, Closed=False)
end_15 = EndPoints(Curve=ext_6)  # -> Start, End; disabled
end_16 = EndPoints(Curve=ext_7)  # -> Start, End; disabled
end_17 = EndPoints(Curve=ext_8)  # -> Start, End
end_18 = EndPoints(Curve=ext_9)  # -> Start, End
pt_45 = PointOriented(BasePlane=area_6.Centroid, UComponent=Slider(0.1, range=0..0.1), VComponent=0, WComponent=0)
pt_46 = PointOriented(BasePlane=area_7.Centroid, UComponent=Slider(0.1, range=0..0.1), VComponent=0, WComponent=0)
xy_17 = XYPlane(Origin=area_6.Centroid)
xy_18 = XYPlane(Origin=area_7.Centroid)
number_slider_35 = Slider(1, range=0..1)  # disabled
number_slider_36 = Slider(1, range=0..1)  # disabled
number_slider_37 = Slider(5, range=0..10)  # disabled
number_slider_38 = Slider(5, range=0..10)  # disabled
pl_origin_4 = PlaneOrigin(Base=pl_4, Origin=end_15.Start)  # disabled
pl_origin_5 = PlaneOrigin(Base=pl_5, Origin=end_16.Start)  # disabled
pl_origin_6 = PlaneOrigin(Base=pl_6, Origin=end_17.Start)
pl_origin_7 = PlaneOrigin(Base=pl_7, Origin=end_18.Start)
crv_cp_9 = CurveClosestPoint(Point=pt_45, Curve=crv_33)  # -> Point, Parameter, Distance
crv_cp_10 = CurveClosestPoint(Point=pt_46, Curve=crv_34)  # -> Point, Parameter, Distance
vec2pt_15 = Vector2Pt(PointA=area_6.Centroid, PointB=crv_cp_9.Point, Unitize=False)  # -> Vector, Length
vec2pt_16 = Vector2Pt(PointA=area_7.Centroid, PointB=crv_cp_10.Point, Unitize=False)  # -> Vector, Length
dist_4 = Distance(PointA=crv_cp_9.Point, PointB=area_6.Centroid)
dist_5 = Distance(PointA=crv_cp_10.Point, PointB=area_7.Centroid)
pt_47 = PointOriented(BasePlane=pl_origin_4, UComponent=number_slider_35, VComponent=0, WComponent=0)  # disabled
pt_48 = PointOriented(BasePlane=pl_origin_4, UComponent=0, VComponent=number_slider_37, WComponent=0)  # disabled
pt_49 = PointOriented(BasePlane=pl_origin_5, UComponent=number_slider_36, VComponent=0, WComponent=0)  # disabled
pt_50 = PointOriented(BasePlane=pl_origin_5, UComponent=0, VComponent=number_slider_38, WComponent=0)  # disabled
pt_51 = PointOriented(BasePlane=pl_origin_6, UComponent=Slider(1, range=0..1), VComponent=0, WComponent=0)
pt_52 = PointOriented(BasePlane=pl_origin_6, UComponent=0, VComponent=Slider(3, range=0..10), WComponent=0)
pt_53 = PointOriented(BasePlane=pl_origin_7, UComponent=Slider(1, range=0..1), VComponent=0, WComponent=0)
pt_54 = PointOriented(BasePlane=pl_origin_7, UComponent=0, VComponent=Slider(3, range=0..10), WComponent=0)
merge_34 = Merge(Data1=pt_47, Data2=pl_origin_4, Data3=pt_48)  # disabled
merge_35 = Merge(Data1=pt_49, Data2=pl_origin_5, Data3=pt_50)  # disabled
align_4 = AlignPlane(Plane=xy_17, Direction=vec2pt_15.Vector)  # -> Plane, Angle
align_5 = AlignPlane(Plane=xy_18, Direction=vec2pt_16.Vector)  # -> Plane, Angle
multiplication_6 = Multiplication(A=dist_4, B="2")
multiplication_7 = Multiplication(A=dist_5, B="2")
merge_36 = Merge(Data1=pt_51, Data2=pl_origin_6, Data3=pt_52)
merge_37 = Merge(Data1=pt_53, Data2=pl_origin_7, Data3=pt_54)
pline_6 = PolyLine(Vertices=merge_34, Closed=False)  # disabled
pline_7 = PolyLine(Vertices=merge_35, Closed=False)  # disabled
pline_8 = PolyLine(Vertices=merge_36, Closed=False)
pline_9 = PolyLine(Vertices=merge_37, Closed=False)

# ---- group: カット
merge_38 = Merge(Data1=pline_6, Data2=pline_7)  # disabled

# ----
subtraction_13 = Subtraction(A=Slider(0.4, range=0..10), B=Slider(4, range=0..10))
addition_11 = Addition(A=Slider(0.4, range=0..10), B=Slider(3.5, range=0..10))
pt_55 = PointOriented(BasePlane=align_5.Plane, UComponent=0, VComponent=Slider(0.4, range=0..10), WComponent=0)
pt_56 = PointOriented(BasePlane=align_5.Plane, UComponent=0, VComponent=Slider(3.504, range=0..10), WComponent=0)
pt_57 = PointOriented(BasePlane=align_4.Plane, UComponent=0, VComponent=subtraction_13, WComponent=0)
pt_58 = PointOriented(BasePlane=align_4.Plane, UComponent=0, VComponent=addition_11, WComponent=0)
num_5 = Number(Slider(1, range=0..1))
num_6 = Number(multiplication_6)
num_7 = Number(multiplication_6)
num_8 = Number(multiplication_7)
pl_origin_8 = PlaneOrigin(Base=align_4.Plane, Origin=pt_57)
pl_origin_9 = PlaneOrigin(Base=align_4.Plane, Origin=pt_58)
addition_12 = Addition(A=num_6, B=num_5)
addition_13 = Addition(A=num_8, B=num_5)
pl_origin_10 = PlaneOrigin(Base=align_5.Plane, Origin=pt_55)
pl_origin_11 = PlaneOrigin(Base=align_5.Plane, Origin=pt_56)
addition_14 = Addition(A=num_7, B=num_5)

# ---- group: 展開用横部材
division_50 = Division(A=addition_12, B="2")
division_51 = Division(A=Slider(4.5, range=0..10), B="2")
neg_42 = Negative(Value=division_50)
neg_43 = Negative(Value=division_51)
dom_36 = ConstructDomain(DomainStart=division_50, DomainEnd=neg_42)
dom_37 = ConstructDomain(DomainStart=division_51, DomainEnd=neg_43)
rectangle_16 = Rectangle(Plane=pl_origin_8, XSize=dom_36, YSize=dom_37, Radius=0)  # -> Rectangle, Length

division_52 = Division(A=addition_14, B="2")
division_53 = Division(A=Slider(3.5, range=0..10), B="2")
neg_44 = Negative(Value=division_52)
neg_45 = Negative(Value=division_53)
dom_38 = ConstructDomain(DomainStart=division_52, DomainEnd=neg_44)
dom_39 = ConstructDomain(DomainStart=division_53, DomainEnd=neg_45)
rectangle_17 = Rectangle(Plane=pl_origin_9, XSize=dom_38, YSize=dom_39, Radius=0)  # -> Rectangle, Length

division_54 = Division(A=Slider(1.95, range=0..2), B="2")
division_55 = Division(A=Slider(3.1, range=0..10), B="2")
neg_46 = Negative(Value=division_54)
neg_47 = Negative(Value=division_55)
dom_40 = ConstructDomain(DomainStart=division_54, DomainEnd=neg_46)
dom_41 = ConstructDomain(DomainStart=division_55, DomainEnd=neg_47)
rectangle_18 = Rectangle(Plane=pl_origin_11, XSize=dom_40, YSize=dom_41, Radius=0)  # -> Rectangle, Length

division_56 = Division(A=addition_13, B="2")
division_57 = Division(A=Slider(3.4, range=0..10), B="2")
neg_48 = Negative(Value=division_56)
neg_49 = Negative(Value=division_57)
dom_42 = ConstructDomain(DomainStart=division_56, DomainEnd=neg_48)
dom_43 = ConstructDomain(DomainStart=division_57, DomainEnd=neg_49)
rectangle_19 = Rectangle(Plane=pl_origin_10, XSize=dom_42, YSize=dom_43, Radius=0)  # -> Rectangle, Length

# ----
explode_17 = Explode(Curve=rectangle_18.Rectangle, Recursive=True)  # -> Segments, Vertices
explode_18 = Explode(Curve=rectangle_17.Rectangle, Recursive=True)  # -> Segments, Vertices
number_slider_39 = Slider(0, range=0..10)
explode_19 = Explode(Curve=rectangle_16.Rectangle, Recursive=True)  # -> Segments, Vertices
number_slider_40 = Slider(2, range=0..10)
number_slider_41 = Slider(1, range=0..10)
number_slider_42 = Slider(1, range=0..10)
cull_i_4 = CullIndex(List=explode_19.Segments, Indices=Slider(0, range=0..10), Wrap=True)
cull_i_5 = CullIndex(List=explode_18.Segments, Indices=Slider(2, range=0..10), Wrap=True)
cull_i_6 = CullIndex(List=explode_17.Segments, Indices=[Slider(2, range=0..10), Slider(0, range=0..10)], Wrap=True)

# ---- group: カット
merge_39 = Merge(Data1=pline_8, Data2=pline_9)

# ----
ext_10 = ExtendCurve(Curve=pline_5, Type=0, Start=number_slider_42, End=number_slider_42)
ext_11 = ExtendCurve(Curve=pline_4, Type=0, Start=number_slider_41, End=number_slider_41)
hull_6 = ConvexHull(Points=pt_39, Plane=PlaneXY(0, 0, 0))  # -> Hull, HullZ, Indices
crv_35 = Curve(rectangle_19.Rectangle)
rectangle_20 = Rectangle(Plane=align_3.Plane, XSize=dom_34, YSize=dom_35, Radius=0)  # -> Rectangle, Length

# ---- group: ぬり
crv_36 = Curve(rint)

crv_37 = Curve(rint_2)

# ----
tag_4 = TextTag3D(Location=pt_35, Text=merge_22, Size=merge_29, Justification=Slider(5, range=0..10))
tag_5 = TextTag3D(Location=pt_38, Text=merge_21, Size=merge_28, Justification=Slider(5, range=0..10))
tag_6 = TextTag3D(Location=pt_37, Text=merge_26, Size=merge_30, Justification=Slider(5, range=0..10))
tag_7 = TextTag3D(Location=pt_36, Text=merge_27, Size=merge_31, Justification=Slider(5, range=0..10))

crv_38 = Curve([<curve referenced from the Rhino model> x30])

explode_20 = Explode(Curve=crv_38, Recursive=True)  # -> Segments, Vertices
item_53 = ListItem(List=explode_20.Segments, Index=0, Wrap=True)  # -> Item, Item1, Item2
curvepoint = PointOnCurve(item_53.Item2, parameter=0.5)

pdecon_15 = Deconstruct(Point=curvepoint)  # -> XComponent, YComponent, ZComponent
cset_5 = CreateSet(List=pdecon_15.XComponent)  # -> Set, Map
cset_6 = CreateSet(List=pdecon_15.YComponent)  # -> Set, Map
sort_6 = SortList(Keys=cset_6.Set)  # -> reverse(Keys), ValuesA
sort_7 = SortList(Keys=cset_5.Set)  # -> Keys, ValuesA
pt_59 = ConstructPoint(XCoordinate=graft(sort_7.Keys), YCoordinate=sort_6.Keys, ZCoordinate=0)  # -> flatten(Point)
xy_19 = XYPlane(Origin=pt_59)
points_3 = PointList(Points=pt_59, Size=Slider(8, range=0..100))

# ---- group: 展開用縦部材
number_slider_43 = Slider(114, range=0..114)
division_58 = Division(A=number_slider_43, B="2")
division_59 = Division(A=Slider(9.3, range=0..10), B="2")
neg_50 = Negative(Value=division_58)
neg_51 = Negative(Value=division_59)
dom_44 = ConstructDomain(DomainStart=division_58, DomainEnd=neg_50)
dom_45 = ConstructDomain(DomainStart=division_59, DomainEnd=neg_51)
rectangle_21 = Rectangle(Plane=xy_19, XSize=number_slider_43, YSize=dom_45, Radius=0)  # -> Rectangle, Length

# ----
crv_39 = Curve(crv_38)
short = ShortestList(ListD=pl_2, ListA=sec.Curves, ListC=xy_19, TrimMode=2)  # -> ListD, ListA, ListC
short_2 = ShortestList(ListD=pl_2, ListA=crv_16, ListC=xy_19, TrimMode=2)  # -> ListD, ListA, ListC
merge_40 = Merge(Data1=short.ListA)
merge_41 = Merge(Data2=short_2.ListA)
points_4 = PointList(Points=xy_19, Size=Slider(10, range=0..10))
orient_10 = Orient(Geometry=merge_40, Source=short.ListD, Target=short.ListC)  # -> Geometry, Transform
orient_11 = Orient(Geometry=merge_41, Source=short_2.ListD, Target=short_2.ListC)  # -> Geometry, Transform
panel_36 = Panel(xy_19)

crv_40 = Curve(graft(rectangle_2.Rectangle))
pln_37 = Plane(graft(hframe_3))
部材厚_5 = Slider(1.9, range=0..10)
deplane_11 = DeconstructPlane(Plane=pln_37)  # -> Origin, XAxis, YAxis, ZAxis
division_60 = Division(A=部材厚_5, B="2")
amp_13 = Amplitude(Vector=deplane_11.ZAxis, Amplitude=division_60)
rev_9 = Reverse(Vector=deplane_11.ZAxis)
amp_14 = Amplitude(Vector=rev_9, Amplitude=部材厚_5)

fillet_3 = Fillet(Curve=crv_40, Radius=Slider(5, range=0..10))

boundary_10 = BoundarySurfaces(Edges=fillet_3)
move_15 = Move(Geometry=boundary_10, Motion=amp_13)  # -> Geometry, Transform
extr_9 = Extrude(Base=move_15.Geometry, Direction=amp_14)

preview_13 = CustomPreview(Geometry=extr_9, Material=ColourSwatch(SwatchColor=RGB(255, 102, 0)))

crv_41 = Curve(graft(rectangle_3.Rectangle))  # disabled
pln_38 = Plane(graft(rotate_6.Geometry))  # disabled
部材厚_6 = Slider(1.9, range=0..10)  # disabled
panel_37 = Panel("2")  # disabled
deplane_12 = DeconstructPlane(Plane=pln_38)  # -> Origin, XAxis, YAxis, ZAxis; disabled
division_61 = Division(A=部材厚_6, B=panel_37)  # disabled
amp_15 = Amplitude(Vector=deplane_12.ZAxis, Amplitude=division_61)  # disabled
rev_10 = Reverse(Vector=deplane_12.ZAxis)  # disabled
amp_16 = Amplitude(Vector=rev_10, Amplitude=部材厚_6)  # disabled

fillet_4 = Fillet(Curve=crv_41, Radius=number_slider_18)  # disabled

boundary_11 = BoundarySurfaces(Edges=fillet_4)  # disabled
move_16 = Move(Geometry=boundary_11, Motion=amp_15)  # -> Geometry, Transform; disabled
extr_10 = Extrude(Base=move_16.Geometry, Direction=amp_16)  # disabled

preview_14 = CustomPreview(Geometry=extr_10, Material=swatch)  # disabled

# ---- group: 横部材が干渉するときのずらしジョイント
bbox = BoundingBox(Content=hull_5.Hull, Plane=PlaneXY(0, 0, 0))  # -> Box, Box_2; disabled
bbox_2 = BoundingBox(Content=hull_4.Hull, Plane=PlaneXY(0, 0, 0))  # -> Box, Box_2; disabled
area_8 = Area(Geometry=hull_5.Hull)  # -> Area, Centroid; disabled
area_9 = Area(Geometry=hull_4.Hull)  # -> Area, Centroid; disabled
edges = BrepEdges(Brep=bbox.Box_2)  # -> Naked, Interior, NonManifold; disabled
edges_2 = BrepEdges(Brep=bbox_2.Box_2)  # -> Naked, Interior, NonManifold; disabled
number_slider_44 = Slider(1.874, range=0..10)  # disabled
number_slider_45 = Slider(2.108, range=0..10)  # disabled
number_slider_46 = Slider(0.245, range=0..10)  # disabled
item_54 = ListItem(List=edges.Naked, Index=0, Wrap=True)  # disabled
item_55 = ListItem(List=edges_2.Naked, Index=0, Wrap=True)  # disabled
number_slider_47 = Slider(1.606, range=0..10)  # disabled
len_11 = Length(Curve=item_54)  # disabled
len_12 = Length(Curve=item_55)  # disabled
neg_52 = Negative(Value=number_slider_45)  # disabled
neg_53 = Negative(Value=number_slider_46)  # disabled
pt_60 = PointOriented(BasePlane=area_8.Centroid, UComponent=0, VComponent=number_slider_44, WComponent=0)  # disabled
pt_61 = PointOriented(BasePlane=area_9.Centroid, UComponent=0, VComponent=neg_52, WComponent=0)  # disabled
pt_62 = PointOriented(BasePlane=area_8.Centroid, UComponent=0, VComponent=neg_53, WComponent=0)  # disabled
pt_63 = PointOriented(BasePlane=area_9.Centroid, UComponent=0, VComponent=number_slider_47, WComponent=0)  # disabled
number_slider_48 = Slider(2, range=0..10)  # disabled
number_slider_49 = Slider(4, range=0..10)  # disabled

# ---- group: 横部材が干渉するときのずらしジョイント / 展開用横部材
number_slider_50 = Slider(1.95, range=0..2)  # disabled
number_slider_51 = Slider(2.8, range=0..10)  # disabled
panel_38 = Panel("2")  # disabled
panel_39 = Panel("2")  # disabled
division_62 = Division(A=number_slider_50, B=panel_39)  # disabled
division_63 = Division(A=number_slider_51, B=panel_38)  # disabled
neg_54 = Negative(Value=division_62)  # disabled
neg_55 = Negative(Value=division_63)  # disabled
dom_46 = ConstructDomain(DomainStart=division_62, DomainEnd=neg_54)  # disabled
dom_47 = ConstructDomain(DomainStart=division_63, DomainEnd=neg_55)  # disabled
rectangle_22 = Rectangle(Plane=pt_60, XSize=dom_46, YSize=dom_47, Radius=0)  # -> Rectangle, Length; disabled

number_slider_52 = Slider(2.7, range=0..10)  # disabled
number_slider_53 = Slider(7, range=0..114)  # disabled
panel_40 = Panel("2")  # disabled
panel_41 = Panel("2")  # disabled
division_64 = Division(A=len_12, B=panel_41)  # disabled
division_65 = Division(A=number_slider_52, B=panel_40)  # disabled
neg_56 = Negative(Value=division_64)  # disabled
neg_57 = Negative(Value=division_65)  # disabled
dom_48 = ConstructDomain(DomainStart=division_64, DomainEnd=neg_56)  # disabled
dom_49 = ConstructDomain(DomainStart=division_65, DomainEnd=neg_57)  # disabled
rectangle_23 = Rectangle(Plane=pt_61, XSize=dom_48, YSize=dom_49, Radius=0)  # -> Rectangle, Length; disabled

number_slider_54 = Slider(1.5, range=0..10)  # disabled
number_slider_55 = Slider(4, range=0..114)  # disabled
panel_42 = Panel("2")  # disabled
panel_43 = Panel("2")  # disabled
division_66 = Division(A=len_11, B=panel_43)  # disabled
division_67 = Division(A=number_slider_54, B=panel_42)  # disabled
neg_58 = Negative(Value=division_66)  # disabled
neg_59 = Negative(Value=division_67)  # disabled
dom_50 = ConstructDomain(DomainStart=division_66, DomainEnd=neg_58)  # disabled
dom_51 = ConstructDomain(DomainStart=division_67, DomainEnd=neg_59)  # disabled
rectangle_24 = Rectangle(Plane=pt_62, XSize=dom_50, YSize=dom_51, Radius=0)  # -> Rectangle, Length; disabled

number_slider_56 = Slider(1.7, range=0..10)  # disabled
number_slider_57 = Slider(7, range=0..114)  # disabled
panel_44 = Panel("2")  # disabled
panel_45 = Panel("2")  # disabled
division_68 = Division(A=len_12, B=panel_45)  # disabled
division_69 = Division(A=number_slider_56, B=panel_44)  # disabled
neg_60 = Negative(Value=division_68)  # disabled
neg_61 = Negative(Value=division_69)  # disabled
dom_52 = ConstructDomain(DomainStart=division_68, DomainEnd=neg_60)  # disabled
dom_53 = ConstructDomain(DomainStart=division_69, DomainEnd=neg_61)  # disabled
rectangle_25 = Rectangle(Plane=pt_63, XSize=dom_52, YSize=dom_53, Radius=0)  # -> Rectangle, Length; disabled

# ---- group: 横部材が干渉するときのずらしジョイント (continued)
explode_21 = Explode(Curve=rectangle_22.Rectangle, Recursive=True)  # -> Segments, Vertices; disabled
explode_22 = Explode(Curve=rectangle_23.Rectangle, Recursive=True)  # -> Segments, Vertices; disabled
cull_i_7 = CullIndex(List=explode_21.Segments, Indices=number_slider_48, Wrap=True)  # disabled
cull_i_8 = CullIndex(List=explode_22.Segments, Indices=number_slider_49, Wrap=True)  # disabled
merge_42 = Merge(Data1=rectangle_24.Rectangle, Data2=cull_i_7)  # disabled
merge_43 = Merge(Data1=rectangle_25.Rectangle, Data2=cull_i_8)  # disabled
